# Dynamo graph 2019 02-28 ExtractWallGeometryArchived.dyn (Dynamo 2.0.2.6826)

# group: SELECT WALL GROUP IN MODEL
categories = Categories(index=153)
all_elements_of_category = ElementsOfCategory(Category=categories)

name = Element.Name(element=all_elements_of_category)
watch = Watch(name)
getLocation = Element.GetLocation(element=all_elements_of_category)
watch_2 = Watch(getLocation)
parameters = Element.Parameters(element=all_elements_of_category)
watch_3 = Watch(parameters)

# group: Working String Thing Backup
string = StringInput("Comments : Shearwall Line A")
python_script = Python(IN[0]=watch_3, IN[1]=string)
# ---------- python_script.python (23 lines) ----------
# Enable Python support and load DesignScript library
import clr
clr.AddReference('ProtoGeometry')
from Autodesk.DesignScript.Geometry import *

# The inputs to this node will be stored as a list in the IN variables.
dataEnteringNode = IN

# Place your code below this line
cat = []
for item in IN[0]:
	if str(item[7]) == IN[1]:
		cat.append(item[7])
	
	#for subitem in item:
	#	if subitem == str(" Comments : Shearwall Type A"):
	#		cat.append(item)
		
		


# Assign your output to the OUT variable.
OUT = cat
# ----------------------------------------
watch_4 = Watch(python_script)

python_script_2 = Python(IN[0]=watch_3)
# ---------- python_script_2.python (24 lines) ----------
# Enable Python support and load DesignScript library
import clr
clr.AddReference('ProtoGeometry')
from Autodesk.DesignScript.Geometry import *

# The inputs to this node will be stored as a list in the IN variables.
dataEnteringNode = IN

# Place your code below this line
WallList = IN
VwallMain = []
for item in WallList:
	if "Comments : Shearwall Line" in str(item):
		VwallMain.append(item)
	
	#for subitem in item:
	#	if subitem == str(" Comments : Shearwall Type A"):
	#		cat.append(item)
		
		


# Assign your output to the OUT variable.
OUT = VwallMain
# ----------------------------------------
watch_5 = Watch(python_script_2)
name_2 = Element.Name(element=all_elements_of_category)
parse_out_shearwall_extents = Python(IN[0]=name_2)
# ---------- parse_out_shearwall_extents.python (15 lines) ----------
# Enable Python support and load DesignScript library
import clr
clr.AddReference('ProtoGeometry')
from Autodesk.DesignScript.Geometry import *

# The inputs to this node will be stored as a list in the IN variables.
dataEnteringNode = IN

# Place your code below this line
VwallExtent = []
for item in IN[0]:
	if item == 'Shearwall Extents':
		VwallExtent.append(item)
# Assign your output to the OUT variable.
OUT = VwallExtent
# ----------------------------------------
watch_6 = Watch(all_elements_of_category)
string_2 = StringInput("Shearwall Extents")
parse_out_shearwall_extents_2 = Python(IN[0]=parameters)
# ---------- parse_out_shearwall_extents_2.python (15 lines) ----------
# Enable Python support and load DesignScript library
import clr
clr.AddReference('ProtoGeometry')
from Autodesk.DesignScript.Geometry import *

# The inputs to this node will be stored as a list in the IN variables.
dataEnteringNode = IN

# Place your code below this line
VwallExtent = []
for item in IN[0]:
	if item == 'Shearwall Extents':
		VwallExtent.append(item)
# Assign your output to the OUT variable.
OUT = VwallExtentasdasd
# ----------------------------------------
