# Dynamo graph ExtractWall.dyn (Dynamo 2.0.2.6826)

# group: EXTRACT WALLS, PARSE OUT SHEARWALLS, PACKAGE AND EXPORT
categories = Categories(index=153)
all_elements_of_category = ElementsOfCategory(Category=categories)
parameters = Element.Parameters(element=all_elements_of_category)
file_path = Filename(".\CSV_Output.csv")

id = Element.Id(element=all_elements_of_category)
# note: This function merges the element ID and the parameters so we can track which element is being modified.
add_element_id_to_parameter_list = Python(IN[0]=id, IN[1]=parameters)
# ---------- add_element_id_to_parameter_list.python (16 lines) ----------
# Enable Python support and load DesignScript library
import clr
clr.AddReference('ProtoGeometry')
from Autodesk.DesignScript.Geometry import *

# The inputs to this node will be stored as a list in the IN variables.
dataEnteringNode = IN

# Place your code below this line
ElementList = []
for cnt, item in enumerate(IN[1]):
	item.append(IN[0][cnt])
	#dummy.append(IN[0][cnt])
	
# Assign your output to the OUT variable.
OUT = IN[1]
# ----------------------------------------

# group (continued): EXTRACT WALLS, PARSE OUT SHEARWALLS, PACKAGE AND EXPORT
# note: This element parses out any
# non Shearwall Extents elements.
parse_out_shearwall_extents = Python(IN[0]=add_element_id_to_parameter_list)
# ---------- parse_out_shearwall_extents.python (19 lines) ----------
# Enable Python support and load DesignScript library
import clr
clr.AddReference('ProtoGeometry')
from Autodesk.DesignScript.Geometry import *

# The inputs to this node will be stored as a list in the IN variables.
dataEnteringNode = IN

# Place your code below this line
VwallExtent = []
for list in IN[0]:
	for item in list:
		if str(item) == 'Type : Shearwall Extents': 
			VwallExtent.append(list)
		#if len(list) > 20:
		#	if item == 'Type : Shearwall Extents':
		#		VwallExtent.append(item)
# Assign your output to the OUT variable.
OUT = VwallExtent
# ----------------------------------------
# note: This parses down information
# into useable stuff and then
# kicks it into a .CSV
export_list_of_wall_line = Python(IN[0]=parse_out_shearwall_extents)  # unwired: IN[1]
# ---------- export_list_of_wall_line.python (30 lines) ----------
# Enable Python support and load DesignScript library
import clr
clr.AddReference('ProtoGeometry')
from Autodesk.DesignScript.Geometry import *

# The inputs to this node will be stored as a list in the IN variables.
dataEnteringNode = IN

# Place your code below this line
VwallList = IN[0]
wallDict = []

for wall in VwallList:

	ElementID = wall[25]
	WallLine = wall[4]
	WallLen = wall[12]
	WallType = wall[20]
	WallHD = wall[9]	

	WallInfo = [ElementID,WallLine,WallLen,WallType,WallHD]
	
	if str(WallType) != 'SW Nailing : 6':
		wallDict.append(WallInfo)
		
		


# Assign your output to the OUT variable.
OUT = wallDict
# ----------------------------------------
watch = Watch(export_list_of_wall_line)
exportCSV = Data.ExportCSV(filePath=file_path, data=export_list_of_wall_line)
