# Dynamo graph WriteWall.dyn (Dynamo 2.0.2.6826)

# group: IMPORT SHEARWALL LINES FROM MODEL
family_types = FamilyTypes(index=400)
all_elements_of_family_type = ElementsOfFamilyType(Family_Type=family_types)
integer_slider = IntegerSlider(1, range=0..100 step 1)
dropItems = List.DropItems(list=all_elements_of_family_type, amount=integer_slider)

# group: IMPORT DATA FROM USER
file_path = Filename(".\CSV_Input.csv")
boolean = BoolSelector(false)
importCSV = Data.ImportCSV(filePath=file_path, transpose=boolean)

watch = Watch(importCSV)

# group: UPDATE SHEARWALL TYPE
string = StringInput("SW Nailing")
number_slider = DoubleSlider(3, range=0..100 step 0.1)
# note: THIS DROP ITEMS IS BECAUSE THERE IS SOME SW ARTIFACT IN THE MODEL I CANNOT TRACK DOWN - SLIGHTLY LAZY BUT THIS IS A PROOF OF CONCEPT.
getItemAtIndex = List.GetItemAtIndex(list=watch, index=number_slider)
setParameterByName = Element.SetParameterByName(element=dropItems, parameterName=string, value=getItemAtIndex)

# group: UPDATE HOLDDOWN TYPE
string_2 = StringInput("HD")
number_slider_2 = DoubleSlider(4, range=0..100 step 0.1)
getItemAtIndex_2 = List.GetItemAtIndex(list=watch, index=number_slider_2)
setParameterByName_2 = Element.SetParameterByName(element=dropItems, parameterName=string_2, value=getItemAtIndex_2)
